# Dynamo graph CreateOnGround_v5.dyn (Dynamo 2.5.0.7460)

# group: Найстройки для создания элементов на поверхности
выбор_элемента = CodeBlock { "Траншея_v1"; "Типовой кабель_v4"; "Труба под путями_v1"; "Рельсошпальная решетка_v4"; }
сброс = BoolSelector(false)
выбор_программы = CodeBlock()
# ---------- выбор_программы.designscript (4 lines) ----------
"1. Вставить элементы по линии";
"2. Поднять элементы на поверхность";
"3. Настроить муфты в кабеле";
"4. Выделить сборку по отрезку";
# ----------------------------------------

тройник = CodeBlock(str=выбор_элемента.out3) { str; }
N_Programms = Python(IN[0]=сброс, IN[1]=выбор_программы.out2)
# ---------- N_Programms.python (12 lines) ----------
str = IN[1]
num = 0
if str == "1. Вставить элементы по линии":
	num = 1
elif str == "2. Поднять элементы на поверхность":
	num = 2
elif str == "3. Настроить муфты в кабеле":
	num = 3
elif str == "4. Выделить сборку по отрезку":
	num = 4

OUT = num
# ----------------------------------------
n2_1_схватить_отрезки = Python(IN[0]=тройник, IN[1]=N_Programms)  # "2.1 Схватить отрезки"
# ---------- n2_1_схватить_отрезки.python (173 lines) ----------
import clr
import sys
import System
from System import Array
from System.Collections.Generic import *
clr.AddReference('ProtoGeometry')
from Autodesk.DesignScript.Geometry import *
DynPoint = Point
DynLine = Line
DynCurve = Curve
clr.AddReference("RevitNodes")
import Revit
clr.ImportExtensions(Revit.Elements)
clr.ImportExtensions(Revit.GeometryConversion)
clr.AddReference("RevitServices")
import RevitServices
from RevitServices.Persistence import DocumentManager 
from RevitServices.Transactions import TransactionManager 

clr.AddReference("RevitAPI")
clr.AddReference("RevitAPIUI")

import Autodesk 
from Autodesk.Revit.DB import *
from Autodesk.Revit.UI import *

def TakePointOnElement(elementOnLine, position):
	point = elementOnLine.Location.Curve.GetEndPoint(position)
	if position == 0:
		additionalZ = elementOnLine.LookupParameter("Доп_смещение_начало").AsDouble()
	elif position == 1:
		additionalZ = elementOnLine.LookupParameter("Доп_смещение_конец").AsDouble()
	curP = XYZ(point.X, point.Y, point.Z + additionalZ)
	return curP

def IsAlmostEqualXYZ(a,b):
	dx1x2 = abs(a.X - b.X)
	dy1y2 = abs(a.Y - b.Y)
	dz1z2 = abs(a.Z - b.Z)
	if (dx1x2 < 2*feetToMm) and (dy1y2 < 2*feetToMm) and (dz1z2 < 2*feetToMm):
		return True
	return False

def SearchNextFirstSection(sections):

	isSec1FirstSection = True
	for sec1 in sections:
		starPoint1 = TakePointOnElement(sec1, 0)
		for sec2 in sections:
			endPoint2 = TakePointOnElement(sec2, 1)
			if IsAlmostEqualXYZ(starPoint1, endPoint2):
				isSec1FirstSection = False
				break
		if isSec1FirstSection:
			return sec1		
		isSec1FirstSection = True
	return False
	
def FindNextSection(sec1, sections):
	#Добавим в сборку
	endPoint1 = TakePointOnElement(sec1, 1)
	for sec2 in sections:
		starPoint2 = TakePointOnElement(sec2, 0)
		if IsAlmostEqualXYZ(endPoint1, starPoint2):	
			return sec2	
	return False	
	
def GetElements(FamilyNameForGet):

	FilteredElements = FilteredElementCollector(doc)
	FilteredElements.OfClass(FamilyInstance)
	FilteredElements.WhereElementIsNotElementType()
	FilteredElements.ToElements()
	sections = []
	#Хватаем все кабели в проекте
	for element in FilteredElements:	
		if element.Symbol.FamilyName == FamilyNameForGet:
			sections.append(element)
			
	#Формируем список в формате кабель/номер кабеля/номер отрезка в кабеле по порядку
	
	lines = []
	starPoint = []
	FirstSections = []
	
	count = 0
	TransactionManager.Instance.EnsureInTransaction(doc)
	MainSectionsSet = []
	Nset = 1
	NsectionInSet = 1
	NextFirstSection = SearchNextFirstSection(sections)
	#sectionsSet [0] - id отрезка; [1] - номер набора; [2] - номер отрезка; [3] - высота до начала; [4] - высота до конца
	TransactionManager.Instance.EnsureInTransaction(doc)
	while NextFirstSection:
		NextFirstSection.LookupParameter("N_Набора").Set(Nset)
		NextFirstSection.LookupParameter("N_Отрезка").Set(NsectionInSet)
		list = [NextFirstSection.Id, Nset, NsectionInSet,0,0]
		MainSectionsSet.append(list)
		NsectionInSet = NsectionInSet + 1
		sections.remove(NextFirstSection)
		nextSection = FindNextSection(NextFirstSection, sections)
		while nextSection:
			nextSection.LookupParameter("N_Набора").Set(Nset)
			nextSection.LookupParameter("N_Отрезка").Set(NsectionInSet)
			list = [nextSection.Id, Nset, NsectionInSet,0,0]
			MainSectionsSet.append(list)
			NsectionInSet = NsectionInSet + 1
			sections.remove(nextSection)
			nextSection = FindNextSection(nextSection, sections)
		NextFirstSection = SearchNextFirstSection(sections)
		Nset = Nset + 1
		NsectionInSet = 1
	TransactionManager.Instance.TransactionTaskDone()		
	Nset = 1
	Nset1 = 1
	Nset2 = 1
	NsectionInSet = 1
	tuneRequire = False
	startJ = 0
	MainSectionsSet_Filter = []
	isLastElement = False
	for i in xrange(0, len(MainSectionsSet), 1):
		sec1 = doc.GetElement(MainSectionsSet[i][0])
		Nset1 = MainSectionsSet[i][1]
		
		if i == len(MainSectionsSet)-1:
			isLastElement = True
		else:
			sec2 = doc.GetElement(MainSectionsSet[i+1][0])	
			Nset2 = MainSectionsSet[i+1][1]
			
		tuneRequire = tuneRequire or sec1.LookupParameter("Требуется_настройка").AsInteger()
		
		#TaskDialog.Show("qwe",str(tuneRequire))
		if ((Nset1 != Nset2) or isLastElement) and (tuneRequire):
			#TaskDialog.Show("qwe",str("enter"))
			for j in xrange(startJ, i+1, 1):
				secID = MainSectionsSet[j][0]
				Nset = MainSectionsSet[j][1]
				NsectionInSet = MainSectionsSet[j][2]
				list = [secID, Nset, NsectionInSet,0,0]
				MainSectionsSet_Filter.append(list)
				
		if Nset1 != Nset2:
			tuneRequire	= False
			startJ = i + 1
	return MainSectionsSet_Filter


from Autodesk.Revit.UI.Selection import *

doc = DocumentManager.Instance.CurrentDBDocument
uiapp = DocumentManager.Instance.CurrentUIApplication 
app = uiapp.Application 
uidoc = uiapp.ActiveUIDocument


FamilyNameForGet = IN[0]
nProgramm = IN[1]
feetToMm = 0.00328084



if (nProgramm == 2) or (nProgramm == 3):
	MainSectionsSet_Filter = GetElements(FamilyNameForGet)
	MainSectionsSet_Filter.insert(0,FamilyNameForGet)
	if nProgramm == 2:
		MainSectionsSet_Filter.insert(0,"programm 2")
	else:
		MainSectionsSet_Filter.insert(0,"programm 3")		
	OUT = MainSectionsSet_Filter
else:
	OUT = []
# ----------------------------------------
h_укладки = CodeBlock { -800; }
n2_2_поднять_отрезки = Python(IN[0]=n2_1_схватить_отрезки, IN[1]=h_укладки)  # "2.2 Поднять отрезки"
# ---------- n2_2_поднять_отрезки.python (172 lines) ----------
# Загрузить стандартную библиотеку Python и библиотеку DesignScript
import clr
clr.AddReference('ProtoGeometry')
from Autodesk.DesignScript.Geometry import *
DynPoint = Point
DynLine = Line
DynSurface = Surface
import math

clr.AddReference("RevitAPI")
clr.AddReference("RevitAPIUI")
from Autodesk.Revit.UI import *
import Autodesk
from Autodesk.Revit.DB import *
from Autodesk.Revit.DB import ElementId as DBElementId
from Autodesk.Revit.DB import ElementTransformUtils as DBElementTransformUtils

clr.AddReference("RevitServices")
import RevitServices

from RevitServices.Persistence import DocumentManager
from RevitServices.Transactions import TransactionManager

import clr

global count
count = 0

def GetAllTopoPoints():
	topoFilter = ElementCategoryFilter(BuiltInCategory.OST_Topography)
	topoSurfaces = FilteredElementCollector(doc).WherePasses(topoFilter).ToElements()
	#topoSurfaces = FilteredElementCollector(doc).WherePasses(topoFilter).ToElements()
	topo_points = []
	topo_points = topoSurfaces[0].GetPoints()
	if len(topoSurfaces)>1:
		for i in xrange(1, len(topoSurfaces), 1):
			topo_points = topo_points + topoSurfaces[i].GetPoints()
	return topo_points

def PlaceFamInst(sec, ShiftFromTheGround, groundZ1, groundZ2):
	p = sec.LookupParameter("1_ВысотаОтЗемлиДоНачала")
	p.Set(ShiftFromTheGround)
	p = sec.LookupParameter("2_ВысотаОтЗемлиДоКонца")
	p.Set(ShiftFromTheGround)
	p = sec.LookupParameter("3_ВысотаОт0доЗемлиДляНачала")
	p.Set(groundZ1)	
	p = sec.LookupParameter("4_ВысотаОт0доЗемлиДляКонца")
	p.Set(groundZ2)	
	return 0	
	
def LengthXYTopoPointsToPoint(topoPoints,curPoint):
	topoPointsAndLength=[]
	i = 0
	for topoPoint in topoPoints:
		length = math.sqrt((topoPoint.X - curPoint.X)**2 + (topoPoint.Y - curPoint.Y)**2)
		list = [topoPoint, length]
		topoPointsAndLength.append(list)
	return topoPointsAndLength
	
def PointOnTheGround(topoPointsAndLength, curPoint):
	O = curPoint	
	topoPointsAndLength.sort(key=lambda i: i[1])
	if 	len(topoPointsAndLength) > 200:#ограничемся 200ю ближайшими точками
		stop = 200
	else:
		stop = len(topoPointsAndLength)
	zMax = 0
	zMin = 0
	for i in xrange(0, stop):#Найдем макс и мин точки в области осмотра
		if zMax < topoPointsAndLength[i][0].Z:
			zMax = topoPointsAndLength[i][0].Z
		if zMin > topoPointsAndLength[i][0].Z:
			zMin = topoPointsAndLength[i][0].Z	
	
	dCurLine = DynLine.ByStartPointEndPoint(DynPoint.ByCoordinates(O.X,O.Y,zMin-1000), DynPoint.ByCoordinates(O.X,O.Y,zMax+1000))
	
	YesPoint = False
	DynIntersectionPoint = 0
	checkList = []
	global count
	stop = 0
	pointsLeft = len(topoPointsAndLength)
	while stop < len(topoPointsAndLength):
		if pointsLeft > 10:
			stop = stop + 10
		else:
			stop = pointsLeft
		for i1 in xrange(0, stop):
			A = topoPointsAndLength[i1][0]
			for i2 in xrange(i1+1, stop):
				B = topoPointsAndLength[i2][0]
				for i3 in xrange(i2+1, stop):					 
					count = count + 1
					C = topoPointsAndLength[i3][0]
					OAxAB = (A.X - O.X) * (B.Y - A.Y) - (B.X - A.X) * (A.Y - O.Y)
					OBxBC = (B.X - O.X) * (C.Y - B.Y) - (C.X - B.X) * (B.Y - O.Y)
					OCxCA = (C.X - O.X) * (A.Y - C.Y) - (A.X - C.X) * (C.Y - O.Y)
					if ((OAxAB >= 0) and (OBxBC >= 0) and (OCxCA >= 0)) or ((OAxAB <= 0) and (OBxBC <= 0) and (OCxCA <= 0)):
						AO = math.sqrt((A.X - O.X)**2 + (A.Y - O.Y)**2)
						BO = math.sqrt((B.X - O.X)**2 + (B.Y - O.Y)**2)
						CO = math.sqrt((C.X - O.X)**2 + (C.Y - O.Y)**2)
						kAz = BO * CO / (AO + 0.01) #коэфициент силы координаты Z для точки A
						kBz = AO * CO / (BO + 0.01)
						kCz = AO * BO / (CO + 0.01)
						kkAz = kAz/(kAz + kBz + kCz)
						kkBz = kBz/(kAz + kBz + kCz)
						kkCz = kCz/(kAz + kBz + kCz)
						Z = A.Z * kkAz + B.Z * kkBz + C.Z * kkCz
						return Z										

def riseElements():
	groundZ1 = []
	groundZ2 = []
	i = 0
	
	topo_points = GetAllTopoPoints()
	TransactionManager.Instance.EnsureInTransaction(doc)
	#Cab_NCab_Nsec [0] - кабель; [1] - номер кабеля; [2] - номер отрезка; [3] - высота до начала; [4] - высота до конца
	for secSet in MainSectionsSet:
		sec = doc.GetElement(secSet[0])
		XyzStartPoint = sec.Location.Curve.GetEndPoint(0)
		dynStartPoint = DynPoint.ByCoordinates(XyzStartPoint.X, XyzStartPoint.Y, XyzStartPoint.Z)
		XyzEndPoint = sec.Location.Curve.GetEndPoint(1)
		dynEndPoint = DynPoint.ByCoordinates(XyzEndPoint.X, XyzEndPoint.Y, XyzEndPoint.Z)
		
		lenTopoPStart = LengthXYTopoPointsToPoint(topo_points,XyzStartPoint)
		lenTopoPEnd = LengthXYTopoPointsToPoint(topo_points,XyzEndPoint)	
		#TaskDialog.Show("Оповещение!", str(PointOnTheGround(lenTopoPStart, dynStartPoint)))
		groundZ1.append(PointOnTheGround(lenTopoPStart, dynStartPoint))
		
		groundZ2.append(PointOnTheGround(lenTopoPEnd, dynEndPoint))
	
		PlaceFamInst(sec, ShiftFromTheGround, groundZ1[i], groundZ2[i])
		
		MainSectionsSet[i][3] = groundZ1[i] + ShiftFromTheGround + sec.LookupParameter("Доп_смещение_начало").AsDouble()
		MainSectionsSet[i][4] = groundZ2[i] + ShiftFromTheGround + sec.LookupParameter("Доп_смещение_конец").AsDouble()	
		i = i + 1
		
	TransactionManager.Instance.TransactionTaskDone()

	return 1
doc = DocumentManager.Instance.CurrentDBDocument
uidoc = DocumentManager.Instance.CurrentUIApplication.ActiveUIDocument

MainSectionsSet = IN[0]
feetToMm = 0.00328084
ShiftFromTheGround=IN[1] * feetToMm

if MainSectionsSet:
	elementTypeString = MainSectionsSet.pop(1)
	programmNum = MainSectionsSet.pop(0)
	if programmNum == "programm 2":
		goodLevel = True
		for secSet in MainSectionsSet:
			sec = doc.GetElement(secSet[0])
			elementLevelName = sec.Host.Name
			#elementLevelName=123
			if elementLevelName != "LevelAbsolutZero":
				TaskDialog.Show("Оповещение!", "Объекты не на слое LevelAbsolutZero")
				goodLevel = False	
		if goodLevel:
			riseElements()
			MainSectionsSet.insert(0, elementTypeString)
			MainSectionsSet.insert(0, programmNum)
			#TaskDialog.Show("Оповещение!", "Отрезки подняты")
			OUT = MainSectionsSet
		else: 	
			OUT = []
	else:
		OUT = []
else:
	OUT = []
# ----------------------------------------
n2_3_1_настройка_кабеля = Python(IN[0]=n2_2_поднять_отрезки)  # "2.3.1 Настройка КАБЕЛЯ"
# ---------- n2_3_1_настройка_кабеля.python (156 lines) ----------
# Загрузить стандартную библиотеку Python и библиотеку DesignScript
import clr
clr.AddReference('ProtoGeometry')
from Autodesk.DesignScript.Geometry import *
DynPoint = Point
DynLine = Line
DynSurface = Surface
import math

clr.AddReference("RevitAPI")
clr.AddReference("RevitAPIUI")
from Autodesk.Revit.UI import *
import Autodesk
from Autodesk.Revit.DB import *
from Autodesk.Revit.DB import ElementId as DBElementId
from Autodesk.Revit.DB import ElementTransformUtils as DBElementTransformUtils

clr.AddReference("RevitServices")
import RevitServices

from RevitServices.Persistence import DocumentManager
from RevitServices.Transactions import TransactionManager

import time

def Collinearity(A,B):
	k1xi = A.Y*B.Z - A.Z*B.Y
	k2xj = A.X*B.Z - A.Z*B.X
	k3xk = A.X*B.Y - A.Y*B.X
	if (k1xi == 0) and (k2xj == 0) and (k3xk == 0):
		return True
	else:
		return False
	
def AngleBetweenVectors(A,B):
	modA = math.sqrt(A.X**2 + A.Y**2 + A.Z**2)
	modB = math.sqrt(B.X**2 + B.Y**2 + B.Z**2)
	scalAxB = A.X*B.X + A.Y*B.Y + A.Z*B.Z
	return (math.degrees(math.acos(scalAxB/(modA*modB))))
	
def Perpendicular_z0(X,Y):
	napravlenie = 1 #1 если вправо, -1 если влево
	anyLen = 10 #любой X или Y для перпендикуляра
	if (((X >= 0) and (Y > 0)) or ((X < 0) and (Y > 0))): 
		perp = XYZ(anyLen,-X/Y*anyLen,0)
	elif (Y == 0) and (X > 0):
		perp = XYZ(0,-anyLen,0)
	elif (Y == 0) and (X < 0):
		perp = XYZ(0,anyLen,0)
	else:
		perp = XYZ(-anyLen,X/Y*anyLen,0)
	perp = XYZ(perp.X*napravlenie, perp.Y*napravlenie, perp.Z*napravlenie)
	return perp
	
def vectorMult(a,b):
	X = a.Y*b.Z - a.Z*b.Y
	Y = a.Z*b.X - a.X*b.Z
	Z = a.X*b.Y - a.Y*b.X
	c = XYZ(X,Y,Z)
	return c
	
def scalarMult(a,b):
	c = a.X*b.X + a.Y*b.Y + a.Z*b.Z
	return c
	
def BendFamInst(cab1, cab2, cab1Ground1, cab1Ground2, cab2Ground2):	

	Xyz1 = cab1.Location.Curve.GetEndPoint(0)
	Xyz1 = Xyz1 + XYZ(0,0,cab1Ground1)
	Xyz2 = cab1.Location.Curve.GetEndPoint(1)
	Xyz2 = Xyz2 + XYZ(0,0,cab1Ground2)
	Xyz3 = cab2.Location.Curve.GetEndPoint(1)
	Xyz3 = Xyz3 + XYZ(0,0,cab2Ground2)
	##первый отрезок кабеляэто AB, второй отрезок кабеля это BC
	BA = XYZ(Xyz1.X - Xyz2.X, Xyz1.Y - Xyz2.Y, Xyz1.Z - Xyz2.Z)
	AB = XYZ(-BA.X,-BA.Y,-BA.Z)
	BC = XYZ(Xyz3.X - Xyz2.X, Xyz3.Y - Xyz2.Y, Xyz3.Z - Xyz2.Z)
	CB = XYZ(-BC.X,-BC.Y,-BC.Z)
	######################
	if Collinearity(BA,BC):
		#необходимо сбросить все параметры
		alfa = 180
		beta1 = 0
		beta2 = 0
	else:
		alfa = AngleBetweenVectors(BA,BC)	
		#найдем перпендикулярный вектор для AB вправо(направление сгиба)
		ABperp = Perpendicular_z0(AB.X, AB.Y)
		#найдем перпендикулярный вектор для BC вправо(направление сгиба)
		BCperp = Perpendicular_z0(BC.X, BC.Y)		
		#коэффициенты плоскости векторам AB и BC
		a = AB.Y*BC.Z - BC.Y*AB.Z
		b = -(AB.X*BC.Z - BC.X*AB.Z)
		c = AB.X*BC.Y - BC.X*AB.Y
		#коэффициенты плоскости векторам AB и ABperp
		a1 = AB.Y*ABperp.Z - ABperp.Y*AB.Z
		b1 = -(AB.X*ABperp.Z - ABperp.X*AB.Z)
		c1 = AB.X*ABperp.Y - ABperp.X*AB.Y
		#коэффициенты плоскости векторам BC и BCperp
		a2 = BC.Y*BCperp.Z - BCperp.Y*BC.Z
		b2 = -(BC.X*BCperp.Z - BCperp.X*BC.Z)
		c2 = BC.X*BCperp.Y - BCperp.X*BC.Y	
		#TaskDialog.Show("qwe",str(BCperp.X) + " " + str(BCperp.Y))	
		cosBeta1 = (a*a1 + b*b1 + c*c1)/(math.sqrt(a**2 + b**2 + c**2)*math.sqrt(a1**2 + b1**2 + c1**2))
		beta1 = math.degrees(math.acos(cosBeta1))
		cosBeta2 = (a*a2 + b*b2 + c*c2)/(math.sqrt(a**2 + b**2 + c**2)*math.sqrt(a2**2 + b2**2 + c2**2))
		beta2 = math.degrees(math.acos(cosBeta2))
		#Необходимо определить направление поворота одной плоскости на другую
		direction1 = scalarMult(vectorMult(ABperp, BC), AB)
		direction2 = scalarMult(vectorMult(BCperp, BA), BC)
		if direction1 < 0: #если отрицательное, то крутим против часовой стрелки
			beta1 = -beta1	
		if direction2 < 0: #если отрицательное, то крутим против часовой стрелки
			beta2 = -beta2
	###########end if	
	p = cab1.LookupParameter("6_Угол_конца")
	p.Set(math.radians(alfa))
	p = cab2.LookupParameter("5_Угол_начала")
	p.Set(math.radians(alfa))
	p = cab1.LookupParameter("8_Поворот_конца")
	p.Set(math.radians(beta1))
	p = cab2.LookupParameter("7_Поворот_начала")
	p.Set(math.radians(beta2))	
		
def TuneAllElements():
	TransactionManager.Instance.EnsureInTransaction(doc)
	for i in xrange(0, len(MainSectionsSet)-1, 1):
		#TaskDialog.Show("qwe",str(Cab_NCab_Nsec_All[i][1]) + " " + str(Cab_NCab_Nsec_All[i][2]))	
		if i == len(MainSectionsSet):	
			break
		sec1 = doc.GetElement(MainSectionsSet[i][0])
		Nsec1 = MainSectionsSet[i][1]				
		sec2 = doc.GetElement(MainSectionsSet[i+1][0])
		Nsec2 = MainSectionsSet[i+1][1]
		if Nsec1 == Nsec2:
			#TaskDialog.Show("qwe",str(Cab_NCab_Nsec_All[i][2]) + " " + str(Cab_NCab_Nsec_All[i+1][2]))	
			sec1Ground1 =  MainSectionsSet[i][3]
			sec1Ground2 =  MainSectionsSet[i][4]
			sec2Ground2 = MainSectionsSet[i+1][4]
			BendFamInst(sec1, sec2, sec1Ground1, sec1Ground2, sec2Ground2)
		TransactionManager.Instance.TransactionTaskDone()
 
doc = DocumentManager.Instance.CurrentDBDocument
uidoc = DocumentManager.Instance.CurrentUIApplication.ActiveUIDocument

MainSectionsSet = IN[0]
#MainSectionsSet [0] - кабель; [1] - номер кабеля; [2] - номер отрезка; [3] - высота до начала; [4] - высота до конца
feetToMm = 0.00328084

if MainSectionsSet:
	elementTypeString = MainSectionsSet.pop(1)
	programmNum = MainSectionsSet.pop(0)
	if (programmNum == "programm 2") and (elementTypeString == "Типовой кабель_v4"):
		TuneAllElements()
		TaskDialog.Show("Оповещение!", 'Кабель подняли и настроили!')
OUT = []
# ----------------------------------------

# group: 1. Создание элемента
n1_1_схватить_линии_модели = Python(IN[0]=N_Programms)  # "1.1 Схватить линии модели"
# ---------- n1_1_схватить_линии_модели.python (68 lines) ----------
import clr
import sys
import System
from System import Array
from System.Collections.Generic import *
clr.AddReference('ProtoGeometry')
from Autodesk.DesignScript.Geometry import *
DynPoint = Point
DynLine = Line
DynCurve = Curve
clr.AddReference("RevitNodes")
import Revit
clr.ImportExtensions(Revit.Elements)
clr.ImportExtensions(Revit.GeometryConversion)
clr.AddReference("RevitServices")
import RevitServices
from RevitServices.Persistence import DocumentManager 
from RevitServices.Transactions import TransactionManager 

clr.AddReference("RevitAPI")
clr.AddReference("RevitAPIUI")

import Autodesk 
from Autodesk.Revit.DB import *
from Autodesk.Revit.UI import *

doc = DocumentManager.Instance.CurrentDBDocument
uiapp = DocumentManager.Instance.CurrentUIApplication 
app = uiapp.Application 
uidoc = uiapp.ActiveUIDocument

from Autodesk.Revit.UI.Selection import *

def tolist(obj1):
	if hasattr(obj1,"__iter__"): 
		return obj1
	else: 
		return [obj1]
		
class MySelectionFilter(Autodesk.Revit.UI.Selection.ISelectionFilter):
	def __init__(self):
		pass
	def AllowElement(self, element):
		if (element.Category.Name == "Линии"):
			return True
		else:
			return False
	def AllowReference(self, element):
		return False
		
nProgramm = IN[0]

#selection_filter = MySelectionFilter()

#selection = uidoc.Selection;
LinesIds = uidoc.Selection.GetElementIds()
Lines=[]

for id in LinesIds:
	element=doc.GetElement(id)
	if element.Category.Name == "Линии":
		Lines.append(element)
		

if nProgramm == 1:
	OUT = Lines
else:
	OUT = []
# ----------------------------------------
доп_h = CodeBlock { 100; }
n1_2_вставить_отрезки = Python(IN[0]=n1_1_схватить_линии_модели, IN[1]=тройник, IN[2]=доп_h)  # "1.2 Вставить отрезки"
# ---------- n1_2_вставить_отрезки.python (110 lines) ----------
# Загрузить стандартную библиотеку Python и библиотеку DesignScript
import clr
clr.AddReference('ProtoGeometry')
from Autodesk.DesignScript.Geometry import *
DynPoint = Point
DynLine = Line
DynSurface = Surface
import math

clr.AddReference("RevitAPI")
clr.AddReference("RevitAPIUI")
from Autodesk.Revit.UI import *
import Autodesk
from Autodesk.Revit.DB import *
from Autodesk.Revit.DB import ElementId as DBElementId
from Autodesk.Revit.DB import ElementTransformUtils as DBElementTransformUtils

clr.AddReference("RevitServices")
import RevitServices

from RevitServices.Persistence import DocumentManager
from RevitServices.Transactions import TransactionManager

import clr

global count
count = 0
def createFam(LineForFamily, CurFamSymbol):
	feetToMm = 0.00328084
	
	#get base points height
	col_SurveyP = ElementCategoryFilter(BuiltInCategory.OST_SharedBasePoint)
	surveyPoints = FilteredElementCollector(doc).WherePasses(col_SurveyP).ToElements()
	surveyPoint_Z = surveyPoints[0].LookupParameter("Отм").AsDouble()
	col_BaseP = ElementCategoryFilter(BuiltInCategory.OST_ProjectBasePoint)
	basePoints = FilteredElementCollector(doc).WherePasses(col_BaseP).ToElements()	
	basePoint_Z = basePoints[0].LookupParameter("Отм").AsDouble()		
	
	TransactionManager.Instance.EnsureInTransaction(doc)
	#create line for line family
	
	#create or get level for line family
	MyLevels = FilteredElementCollector(doc).OfClass(Level).ToElements()
	baseLevel = 0
	IsBaseLevelExist = False
	b = basePoint_Z
	for level in MyLevels:
		a = level.Elevation
		
		dopusk2mm = abs(a + b)
		#if level.Name == "LevelAbsolutZero":
			#TaskDialog.Show("qwe",str(dopusk2mm))
			#TaskDialog.Show("qwe",str(dopusk2mm))
			#TaskDialog.Show("qwe",str(b))
						
		if level.Name == "LevelAbsolutZero": 
			IsBaseLevelExist = True
			SurveyLevel = level
			if dopusk2mm > (2*feetToMm):
				level.Elevation = -basePoint_Z
			break
	if not IsBaseLevelExist:
		SurveyLevel = Level.Create(doc, 0)
		SurveyLevel.Name = "LevelAbsolutZero"	
	ST = Structure.StructuralType.NonStructural
	newobj = doc.Create.NewFamilyInstance(LineForFamily, CurFamSymbol, SurveyLevel, ST)
	p = newobj.LookupParameter("Доп_смещение_начало")
	p.Set(additional_height*feetToMm)
	p = newobj.LookupParameter("Доп_смещение_конец")
	p.Set(additional_height*feetToMm)
	
	TransactionManager.Instance.TransactionTaskDone()
	return 	
	
def insertSections():
	MyFamilySymbols = FilteredElementCollector(doc).OfClass(FamilySymbol).ToElements()
	CurFamSymbol = 0
	for famS in MyFamilySymbols:
	    if famS.FamilyName == CableFamilyName:
	    	CurFamSymbol = famS
	    	break
	
	ll=0
	dPointStartOnGround = []
	dPointCenterOnGround = []
	dPointEndOnGround = []
	iLine = 0
	
	for modelLine in modelLines:
		XyzStartPoint = modelLine.Location.Curve.GetEndPoint(0)
	
		XyzEndPoint = modelLine.Location.Curve.GetEndPoint(1)
		LineForFamily = Line.CreateBound(XyzStartPoint,XyzEndPoint)
		createFam(LineForFamily, CurFamSymbol)
	return 1
	
doc = DocumentManager.Instance.CurrentDBDocument
uidoc = DocumentManager.Instance.CurrentUIApplication.ActiveUIDocument

modelLines = UnwrapElement(IN[0])
CableFamilyName = IN[1]
additional_height = IN[2]
feetToMm = 0.00328084

if modelLines:
	insertSections()
	TaskDialog.Show("Оповещение!", 'Элементы по линии модели вставлены!')
	OUT = "Done"
else:
	OUT = "No"
# ----------------------------------------
результат = Watch(n1_2_вставить_отрезки)

убрать_треб_настр = BoolSelector(true)
n2_3_2_настройка_траншеи = Python(IN[0]=n2_2_поднять_отрезки, IN[1]=убрать_треб_настр)  # "2.3.2 Настройка ТРАНШЕИ"
# ---------- n2_3_2_настройка_траншеи.python (224 lines) ----------
# Загрузить стандартную библиотеку Python и библиотеку DesignScript
import clr
clr.AddReference('ProtoGeometry')
from Autodesk.DesignScript.Geometry import *
DynPoint = Point
DynLine = Line
DynSurface = Surface
import math

clr.AddReference("RevitAPI")
clr.AddReference("RevitAPIUI")
from Autodesk.Revit.UI import *
import Autodesk
from Autodesk.Revit.DB import *
from Autodesk.Revit.DB import ElementId as DBElementId
from Autodesk.Revit.DB import ElementTransformUtils as DBElementTransformUtils

clr.AddReference("RevitServices")
import RevitServices

from RevitServices.Persistence import DocumentManager
from RevitServices.Transactions import TransactionManager

import time

def Collinearity(A,B):
	k1xi = abs(A.Y*B.Z - A.Z*B.Y)
	k2xj = abs(A.X*B.Z - A.Z*B.X)
	k3xk = abs(A.X*B.Y - A.Y*B.X)
	if (k1xi < 0.1*feetToMm) and (k2xj < 0.1*feetToMm) and (k3xk < 0.1*feetToMm):
		return True
	else:
		return False
	
def AngleBetweenVectors(A,B):
	modA = math.sqrt(A.X**2 + A.Y**2 + A.Z**2)
	modB = math.sqrt(B.X**2 + B.Y**2 + B.Z**2)
	scalAxB = A.X*B.X + A.Y*B.Y + A.Z*B.Z
	return (math.degrees(math.acos(scalAxB/(modA*modB))))
	
def Perpendicular_z0(X,Y):
	napravlenie = 1 #1 если вправо, -1 если влево
	anyLen = 10 #любой X или Y для перпендикуляра
	if (((X >= 0) and (Y > 0)) or ((X < 0) and (Y > 0))): 
		perp = XYZ(anyLen,-X/Y*anyLen,0)
	elif (Y == 0) and (X > 0):
		perp = XYZ(0,-anyLen,0)
	elif (Y == 0) and (X < 0):
		perp = XYZ(0,anyLen,0)
	else:
		perp = XYZ(-anyLen,X/Y*anyLen,0)
	perp = XYZ(perp.X*napravlenie, perp.Y*napravlenie, perp.Z*napravlenie)
	return perp
	
def vectorMult(a,b):
	X = a.Y*b.Z - a.Z*b.Y
	Y = a.Z*b.X - a.X*b.Z
	Z = a.X*b.Y - a.Y*b.X
	c = XYZ(X,Y,Z)
	return c
	
def scalarMult(a,b):
	c = a.X*b.X + a.Y*b.Y + a.Z*b.Z
	return c
	
def BendFamInst(sec1, sec2, sec1Ground1, sec1Ground2, sec2Ground2):	

	Xyz1 = sec1.Location.Curve.GetEndPoint(0)
	Xyz1 = Xyz1 + XYZ(0,0,sec1Ground1)
	Xyz2 = sec1.Location.Curve.GetEndPoint(1)
	Xyz2 = Xyz2 + XYZ(0,0,sec1Ground2)
	Xyz3 = sec2.Location.Curve.GetEndPoint(1)
	Xyz3 = Xyz3 + XYZ(0,0,sec2Ground2)
	##первый отрезок кабеля это AB, второй отрезок кабеля это BC
	
	BA = XYZ(Xyz1.X - Xyz2.X, Xyz1.Y - Xyz2.Y, Xyz1.Z - Xyz2.Z)
	BAhorizont = XYZ(BA.X, BA.Y, 0)	
	AB = XYZ(-BA.X,-BA.Y,-BA.Z)
	BC = XYZ(Xyz3.X - Xyz2.X, Xyz3.Y - Xyz2.Y, Xyz3.Z - Xyz2.Z)
	BChorizont = XYZ(BC.X, BC.Y, 0)
	CB = XYZ(-BC.X,-BC.Y,-BC.Z)
	######################
	directionAlfa = 0
	if Collinearity(BA,BC):
		#необходимо сбросить все параметры
		alfa = 180
		beta = 90	
	else:
		if Collinearity(BAhorizont,BChorizont):
			alfa = 180				
		else:
			alfa = AngleBetweenVectors(BAhorizont,BChorizont)	
			#Найдем вправо ли направлено сл. траншея или влево
			vectorZ = XYZ(0,0,1)
			directionAlfa = scalarMult(vectorMult(BAhorizont, BChorizont), vectorZ) #Если больше нуля, тогда вправо, если меньше то влево
			
		
		#найдем перпендикулярный вектор для BC вправо(направление сгиба)
		#BCperp = Perpendicular_z0(BC.X, BC.Y)	

		#BAshift =  XYZ(BA.X, BA.Y, BA.Z + 100)
		#коэффициенты плоскости заданной векторам BA и BAshift
		#a = BA.Y*BAshift.Z - BAshift.Y*BA.Z
		#b = -(BA.X*BAshift.Z - BAshift.X*BA.Z)
		#c = BA.X*BAshift.Y - BAshift.X*BA.Y
		#v = math.sqrt(a**2 + b**2 + c**2)
		#normal = XYZ(a/v,b/v,c/v)
		#Проекция вектора BC на плоскость qPr=q-dot(q-p,n)*n
		#BC_ = BC - scalarMult(BC,normal)*normal
		beta1 = -(90 - AngleBetweenVectors(BA,XYZ(0,0,1)))*2
		beta2 = -(90 - AngleBetweenVectors(BC,XYZ(0,0,1)))*2
		#TaskDialog.Show("qwe", str(BC_.X)+" "+str(BC_.Y)+" "+str(BC_.Z))
		#TaskDialog.Show("qwe", str(beta1))
		#TaskDialog.Show("qwe", str(beta2))
		#Найдем куда поворачивать, в плюс или в минус
		#найдем перпендикулярный вектор для AB вправо
		#ABperp = Perpendicular_z0(AB.X, AB.Y)
		#directionBeta = scalarMult(vectorMult(BA, BC_), ABperp) #Если больше нуля, тогда по часовой, если меньше, тогда против
		#TaskDialog.Show("qwe", str(directionBeta))
		#коэффициенты плоскости векторам AB и ABperp
		#a1 = AB.Y*ABperp.Z - ABperp.Y*AB.Z
		#b1 = -(AB.X*ABperp.Z - ABperp.X*AB.Z)
		#c1 = AB.X*ABperp.Y - ABperp.X*AB.Y
		#коэффициенты плоскости векторам BC и BCperp
		#a2 = BC.Y*BCperp.Z - BCperp.Y*BC.Z
		#b2 = -(BC.X*BCperp.Z - BCperp.X*BC.Z)
		#c2 = BC.X*BCperp.Y - BCperp.X*BC.Y	
		#TaskDialog.Show("qwe",str(BCperp.X) + " " + str(BCperp.Y))	
		#cosBeta1 = (a*a1 + b*b1 + c*c1)/(math.sqrt(a**2 + b**2 + c**2)*math.sqrt(a1**2 + b1**2 + c1**2))
		#beta1 = math.degrees(math.acos(cosBeta1))
		#cosBeta2 = (a*a2 + b*b2 + c*c2)/(math.sqrt(a**2 + b**2 + c**2)*math.sqrt(a2**2 + b2**2 + c2**2))
		#beta2 = math.degrees(math.acos(cosBeta2))
		#Необходимо определить направление поворота одной плоскости на другую
		#direction1 = scalarMult(vectorMult(ABperp, BC), AB)
		#direction2 = scalarMult(vectorMult(BCperp, BA), BC)
		if directionAlfa < 0: 
			alfa = -alfa	
		#if directionBeta < 0:
		#	beta = -beta
	###########end if	
	p = sec1.LookupParameter("01_Конец_А_угол_горизонт")
	p.Set(math.radians(alfa))
	p = sec2.LookupParameter("02_Начало_А_угол_горизонт")
	p.Set(math.radians(alfa))
	p = sec1.LookupParameter("03_Конец_B_угол_верт")
	p.Set(math.radians(beta1))
	p = sec2.LookupParameter("04_Начало_B_угол_верт")
	p.Set(math.radians(beta2))
	#p = cab2.LookupParameter("5_Угол_начала")
	#p.Set(math.radians(90 - alfa/2))03_Конец_B_угол_верт
	#p = cab1.LookupParameter("8_Поворот_конца")
	#p.Set(math.radians(beta1))
	#p = cab2.LookupParameter("7_Поворот_начала")
	#p.Set(math.radians(beta2))	
	
def insertLenFam():
	TransactionManager.Instance.EnsureInTransaction(doc)
	setLength = 0
	Nset1 = 1#начальный номер наборов
	for i in xrange(0, len(MainSectionsSet), 1):		
		sec2 = doc.GetElement(MainSectionsSet[i][0])
		Nset2 = MainSectionsSet[i][1]			
		p = sec2.LookupParameter("Длина_кабеля_расчетная").AsDouble()	
		if Nset1 == Nset2:
			setLength = setLength + p
		else:
			setLength = p
		Nset1 = Nset2
		p = sec2.LookupParameter("9_Длина_кабеля_от_начала")
		p.Set(setLength)
	TransactionManager.Instance.TransactionTaskDone()
	return 1
		

def TuneAllElements():
	TransactionManager.Instance.EnsureInTransaction(doc)
	for i in xrange(0, len(MainSectionsSet)-1, 1):
		#TaskDialog.Show("qwe",str(Cab_NCab_Nsec_All[i][1]) + " " + str(Cab_NCab_Nsec_All[i][2]))	
		if i == len(MainSectionsSet):	
			break
		sec1 = doc.GetElement(MainSectionsSet[i][0])
		Nsec1 = MainSectionsSet[i][1]				
		sec2 = doc.GetElement(MainSectionsSet[i+1][0])
		Nsec2 = MainSectionsSet[i+1][1]
		if Nsec1 == Nsec2:
			#TaskDialog.Show("qwe",str(Cab_NCab_Nsec_All[i][2]) + " " + str(Cab_NCab_Nsec_All[i+1][2]))	
			sec1Ground1 =  MainSectionsSet[i][3]
			sec1Ground2 =  MainSectionsSet[i][4]
			sec2Ground2 = MainSectionsSet[i+1][4]
			BendFamInst(sec1, sec2, sec1Ground1, sec1Ground2, sec2Ground2)
		TransactionManager.Instance.TransactionTaskDone()
		
def Unсheck_tuneRequirement():		
	TransactionManager.Instance.EnsureInTransaction(doc)
	for secSet in MainSectionsSet:
		sec = doc.GetElement(secSet[0])
		sec.LookupParameter("Требуется_настройка").Set(False)			
	TransactionManager.Instance.TransactionTaskDone()
	return 1
 
doc = DocumentManager.Instance.CurrentDBDocument
uidoc = DocumentManager.Instance.CurrentUIApplication.ActiveUIDocument

MainSectionsSet = IN[0]
uncheckTuneReq = IN[1]
#Cab_NCab_Nsec [0] - кабель; [1] - номер кабеля; [2] - номер отрезка; [3] - высота до начала; [4] - высота до конца
feetToMm = 0.00328084

if MainSectionsSet:
	elementTypeString = MainSectionsSet.pop(1)
	programmNum = MainSectionsSet.pop(0)
	if (programmNum == "programm 2") and (elementTypeString == "Траншея_v1"):
		TuneAllElements()	
		if uncheckTuneReq:
			Unсheck_tuneRequirement()
			TaskDialog.Show("Оповещение!", 'Траншея настроена, чекбокс "Требуется_настройка" выключен!')
			OUT = "Done. Checkbox off"
		else:
			TaskDialog.Show("Оповещение!", 'Траншея настроена, чекбокс "Требуется_настройка" не тронут!')
			OUT = "Done. Checkbox untouch"	
	else:
		OUT = []
else:
	OUT = []
# ----------------------------------------
watch = Watch(n1_1_схватить_линии_модели)
n3_настр_муфт = Python(IN[0]=n2_1_схватить_отрезки, IN[1]=убрать_треб_настр)  # "3 Настр. МУФТ"
# ---------- n3_настр_муфт.python (92 lines) ----------
# Загрузить стандартную библиотеку Python и библиотеку DesignScript
import clr
clr.AddReference('ProtoGeometry')
from Autodesk.DesignScript.Geometry import *
DynPoint = Point
DynLine = Line
DynSurface = Surface
import math

clr.AddReference("RevitAPI")
clr.AddReference("RevitAPIUI")
from Autodesk.Revit.UI import *
import Autodesk
from Autodesk.Revit.DB import *
from Autodesk.Revit.DB import ElementId as DBElementId
from Autodesk.Revit.DB import ElementTransformUtils as DBElementTransformUtils

clr.AddReference("RevitServices")
import RevitServices

from RevitServices.Persistence import DocumentManager
from RevitServices.Transactions import TransactionManager	

def insertLenFam():
	TransactionManager.Instance.EnsureInTransaction(doc)
	setLength = 0
	Nset1_ = MainSectionsSet[0][1] #начальный номер наборов
	curSetCab = []
	lenSet = len(MainSectionsSet)	
	for i in xrange(0, lenSet + 1, 1):
		if i == lenSet:
			for cab in curSetCab:
				cab.LookupParameter("Длина_набора_общая").Set(setLength)
			break
			
		sec1 = doc.GetElement(MainSectionsSet[i][0])
		curSetCab.append(sec1)
		Nset1 = MainSectionsSet[i][1]			
		lSec = sec1.LookupParameter("Длина_кабеля_расчетная").AsDouble()
		if (Nset1_ == Nset1):
			setLength = setLength + lSec
		
		if Nset1_ != Nset1:
			for cab in curSetCab:
				cab.LookupParameter("Длина_набора_общая").Set(setLength)
			del curSetCab[:]
		
		p = sec1.LookupParameter("9_Длина_кабеля_от_начала")
		p.Set(setLength)
		
		if (Nset1_ != Nset1):
			setLength = lSec	
		Nset1_ = Nset1

		

	
	TransactionManager.Instance.TransactionTaskDone()
	return 1
		
def Unсheck_tuneRequirement():		
	TransactionManager.Instance.EnsureInTransaction(doc)
	for secSet in MainSectionsSet:
		sec = doc.GetElement(secSet[0])
		sec.LookupParameter("Требуется_настройка").Set(False)			
	TransactionManager.Instance.TransactionTaskDone()
	return 1
 
doc = DocumentManager.Instance.CurrentDBDocument
uidoc = DocumentManager.Instance.CurrentUIApplication.ActiveUIDocument

MainSectionsSet = IN[0]
uncheckTuneReq = IN[1]
#MainSectionsSet [0] - кабель; [1] - номер кабеля; [2] - номер отрезка; [3] - высота до начала; [4] - высота до конца
feetToMm = 0.00328084



if MainSectionsSet:
	elementTypeString = MainSectionsSet.pop(1)
	programmNum = MainSectionsSet.pop(0)
	if (programmNum == "programm 3") and (elementTypeString == "Типовой кабель_v4"):
		insertLenFam()
		if uncheckTuneReq:
			Unсheck_tuneRequirement()
			TaskDialog.Show("Оповещение!", 'Соед. муфты настроены, чекбокс "Требуется_настройка" выключен!')
			OUT = "Done. Checkbox off"
		else:
			TaskDialog.Show("Оповещение!", 'соед. муфты настроены, чекбокс "Требуется_настройка" не тронут!')
			OUT = "Done. Checkbox untouch"	
else:
	OUT = []
# ----------------------------------------
n2_3_3_настройка_труб = Python(IN[0]=n2_2_поднять_отрезки, IN[1]=убрать_треб_настр)  # "2.3.3 Настройка ТРУБ"
# ---------- n2_3_3_настройка_труб.python (224 lines) ----------
# Загрузить стандартную библиотеку Python и библиотеку DesignScript
import clr
clr.AddReference('ProtoGeometry')
from Autodesk.DesignScript.Geometry import *
DynPoint = Point
DynLine = Line
DynSurface = Surface
import math

clr.AddReference("RevitAPI")
clr.AddReference("RevitAPIUI")
from Autodesk.Revit.UI import *
import Autodesk
from Autodesk.Revit.DB import *
from Autodesk.Revit.DB import ElementId as DBElementId
from Autodesk.Revit.DB import ElementTransformUtils as DBElementTransformUtils

clr.AddReference("RevitServices")
import RevitServices

from RevitServices.Persistence import DocumentManager
from RevitServices.Transactions import TransactionManager

import time

def Collinearity(A,B):
	k1xi = abs(A.Y*B.Z - A.Z*B.Y)
	k2xj = abs(A.X*B.Z - A.Z*B.X)
	k3xk = abs(A.X*B.Y - A.Y*B.X)
	if (k1xi < 0.1*feetToMm) and (k2xj < 0.1*feetToMm) and (k3xk < 0.1*feetToMm):
		return True
	else:
		return False
	
def AngleBetweenVectors(A,B):
	modA = math.sqrt(A.X**2 + A.Y**2 + A.Z**2)
	modB = math.sqrt(B.X**2 + B.Y**2 + B.Z**2)
	scalAxB = A.X*B.X + A.Y*B.Y + A.Z*B.Z
	return (math.degrees(math.acos(scalAxB/(modA*modB))))
	
def Perpendicular_z0(X,Y):
	napravlenie = 1 #1 если вправо, -1 если влево
	anyLen = 10 #любой X или Y для перпендикуляра
	if (((X >= 0) and (Y > 0)) or ((X < 0) and (Y > 0))): 
		perp = XYZ(anyLen,-X/Y*anyLen,0)
	elif (Y == 0) and (X > 0):
		perp = XYZ(0,-anyLen,0)
	elif (Y == 0) and (X < 0):
		perp = XYZ(0,anyLen,0)
	else:
		perp = XYZ(-anyLen,X/Y*anyLen,0)
	perp = XYZ(perp.X*napravlenie, perp.Y*napravlenie, perp.Z*napravlenie)
	return perp
	
def vectorMult(a,b):
	X = a.Y*b.Z - a.Z*b.Y
	Y = a.Z*b.X - a.X*b.Z
	Z = a.X*b.Y - a.Y*b.X
	c = XYZ(X,Y,Z)
	return c
	
def scalarMult(a,b):
	c = a.X*b.X + a.Y*b.Y + a.Z*b.Z
	return c
	
def BendFamInst(sec1, sec2, sec1Ground1, sec1Ground2, sec2Ground2):	

	Xyz1 = sec1.Location.Curve.GetEndPoint(0)
	Xyz1 = Xyz1 + XYZ(0,0,sec1Ground1)
	Xyz2 = sec1.Location.Curve.GetEndPoint(1)
	Xyz2 = Xyz2 + XYZ(0,0,sec1Ground2)
	Xyz3 = sec2.Location.Curve.GetEndPoint(1)
	Xyz3 = Xyz3 + XYZ(0,0,sec2Ground2)
	##первый отрезок кабеля это AB, второй отрезок кабеля это BC
	
	BA = XYZ(Xyz1.X - Xyz2.X, Xyz1.Y - Xyz2.Y, Xyz1.Z - Xyz2.Z)
	BAhorizont = XYZ(BA.X, BA.Y, 0)	
	AB = XYZ(-BA.X,-BA.Y,-BA.Z)
	BC = XYZ(Xyz3.X - Xyz2.X, Xyz3.Y - Xyz2.Y, Xyz3.Z - Xyz2.Z)
	BChorizont = XYZ(BC.X, BC.Y, 0)
	CB = XYZ(-BC.X,-BC.Y,-BC.Z)
	######################
	directionAlfa = 0
	if Collinearity(BA,BC):
		#необходимо сбросить все параметры
		alfa = 180
		beta = 90	
	else:
		if Collinearity(BAhorizont,BChorizont):
			alfa = 180				
		else:
			alfa = AngleBetweenVectors(BAhorizont,BChorizont)	
			#Найдем вправо ли направлено сл. траншея или влево
			vectorZ = XYZ(0,0,1)
			directionAlfa = scalarMult(vectorMult(BAhorizont, BChorizont), vectorZ) #Если больше нуля, тогда вправо, если меньше то влево
			
		
		#найдем перпендикулярный вектор для BC вправо(направление сгиба)
		#BCperp = Perpendicular_z0(BC.X, BC.Y)	

		#BAshift =  XYZ(BA.X, BA.Y, BA.Z + 100)
		#коэффициенты плоскости заданной векторам BA и BAshift
		#a = BA.Y*BAshift.Z - BAshift.Y*BA.Z
		#b = -(BA.X*BAshift.Z - BAshift.X*BA.Z)
		#c = BA.X*BAshift.Y - BAshift.X*BA.Y
		#v = math.sqrt(a**2 + b**2 + c**2)
		#normal = XYZ(a/v,b/v,c/v)
		#Проекция вектора BC на плоскость qPr=q-dot(q-p,n)*n
		#BC_ = BC - scalarMult(BC,normal)*normal
		beta1 = -(90 - AngleBetweenVectors(BA,XYZ(0,0,1)))*2
		beta2 = -(90 - AngleBetweenVectors(BC,XYZ(0,0,1)))*2
		#TaskDialog.Show("qwe", str(BC_.X)+" "+str(BC_.Y)+" "+str(BC_.Z))
		#TaskDialog.Show("qwe", str(beta1))
		#TaskDialog.Show("qwe", str(beta2))
		#Найдем куда поворачивать, в плюс или в минус
		#найдем перпендикулярный вектор для AB вправо
		#ABperp = Perpendicular_z0(AB.X, AB.Y)
		#directionBeta = scalarMult(vectorMult(BA, BC_), ABperp) #Если больше нуля, тогда по часовой, если меньше, тогда против
		#TaskDialog.Show("qwe", str(directionBeta))
		#коэффициенты плоскости векторам AB и ABperp
		#a1 = AB.Y*ABperp.Z - ABperp.Y*AB.Z
		#b1 = -(AB.X*ABperp.Z - ABperp.X*AB.Z)
		#c1 = AB.X*ABperp.Y - ABperp.X*AB.Y
		#коэффициенты плоскости векторам BC и BCperp
		#a2 = BC.Y*BCperp.Z - BCperp.Y*BC.Z
		#b2 = -(BC.X*BCperp.Z - BCperp.X*BC.Z)
		#c2 = BC.X*BCperp.Y - BCperp.X*BC.Y	
		#TaskDialog.Show("qwe",str(BCperp.X) + " " + str(BCperp.Y))	
		#cosBeta1 = (a*a1 + b*b1 + c*c1)/(math.sqrt(a**2 + b**2 + c**2)*math.sqrt(a1**2 + b1**2 + c1**2))
		#beta1 = math.degrees(math.acos(cosBeta1))
		#cosBeta2 = (a*a2 + b*b2 + c*c2)/(math.sqrt(a**2 + b**2 + c**2)*math.sqrt(a2**2 + b2**2 + c2**2))
		#beta2 = math.degrees(math.acos(cosBeta2))
		#Необходимо определить направление поворота одной плоскости на другую
		#direction1 = scalarMult(vectorMult(ABperp, BC), AB)
		#direction2 = scalarMult(vectorMult(BCperp, BA), BC)
		if directionAlfa < 0: 
			alfa = -alfa	
		#if directionBeta < 0:
		#	beta = -beta
	###########end if	
	p = sec1.LookupParameter("01_Конец_А_угол_горизонт")
	p.Set(math.radians(alfa))
	p = sec2.LookupParameter("02_Начало_А_угол_горизонт")
	p.Set(math.radians(alfa))
	p = sec1.LookupParameter("03_Конец_B_угол_верт")
	p.Set(math.radians(beta1))
	p = sec2.LookupParameter("04_Начало_B_угол_верт")
	p.Set(math.radians(beta2))
	#p = cab2.LookupParameter("5_Угол_начала")
	#p.Set(math.radians(90 - alfa/2))03_Конец_B_угол_верт
	#p = cab1.LookupParameter("8_Поворот_конца")
	#p.Set(math.radians(beta1))
	#p = cab2.LookupParameter("7_Поворот_начала")
	#p.Set(math.radians(beta2))	
	
def insertLenFam():
	TransactionManager.Instance.EnsureInTransaction(doc)
	setLength = 0
	Nset1 = 1#начальный номер наборов
	for i in xrange(0, len(MainSectionsSet), 1):		
		sec2 = doc.GetElement(MainSectionsSet[i][0])
		Nset2 = MainSectionsSet[i][1]			
		p = sec2.LookupParameter("Длина_кабеля_расчетная").AsDouble()	
		if Nset1 == Nset2:
			setLength = setLength + p
		else:
			setLength = p
		Nset1 = Nset2
		p = sec2.LookupParameter("9_Длина_кабеля_от_начала")
		p.Set(setLength)
	TransactionManager.Instance.TransactionTaskDone()
	return 1
		

def TuneAllElements():
	TransactionManager.Instance.EnsureInTransaction(doc)
	for i in xrange(0, len(MainSectionsSet)-1, 1):
		#TaskDialog.Show("qwe",str(Cab_NCab_Nsec_All[i][1]) + " " + str(Cab_NCab_Nsec_All[i][2]))	
		if i == len(MainSectionsSet):	
			break
		sec1 = doc.GetElement(MainSectionsSet[i][0])
		Nsec1 = MainSectionsSet[i][1]				
		sec2 = doc.GetElement(MainSectionsSet[i+1][0])
		Nsec2 = MainSectionsSet[i+1][1]
		if Nsec1 == Nsec2:
			#TaskDialog.Show("qwe",str(Cab_NCab_Nsec_All[i][2]) + " " + str(Cab_NCab_Nsec_All[i+1][2]))	
			sec1Ground1 =  MainSectionsSet[i][3]
			sec1Ground2 =  MainSectionsSet[i][4]
			sec2Ground2 = MainSectionsSet[i+1][4]
			BendFamInst(sec1, sec2, sec1Ground1, sec1Ground2, sec2Ground2)
		TransactionManager.Instance.TransactionTaskDone()
		
def Unсheck_tuneRequirement():		
	TransactionManager.Instance.EnsureInTransaction(doc)
	for secSet in MainSectionsSet:
		sec = doc.GetElement(secSet[0])
		sec.LookupParameter("Требуется_настройка").Set(False)			
	TransactionManager.Instance.TransactionTaskDone()
	return 1
 
doc = DocumentManager.Instance.CurrentDBDocument
uidoc = DocumentManager.Instance.CurrentUIApplication.ActiveUIDocument

MainSectionsSet = IN[0]
uncheckTuneReq = IN[1]
#Cab_NCab_Nsec [0] - кабель; [1] - номер кабеля; [2] - номер отрезка; [3] - высота до начала; [4] - высота до конца
feetToMm = 0.00328084

if MainSectionsSet:
	elementTypeString = MainSectionsSet.pop(1)
	programmNum = MainSectionsSet.pop(0)
	if (programmNum == "programm 2") and (elementTypeString == "Труба под путями_v1"):
		TuneAllElements()	
		if uncheckTuneReq:
			Unсheck_tuneRequirement()
			TaskDialog.Show("Оповещение!", 'Трубы подняты, чекбокс "Требуется_настройка" выключен!')
			OUT = "Done. Checkbox off"
		else:
			TaskDialog.Show("Оповещение!", 'Трубы подняты, чекбокс "Требуется_настройка" не тронут!')
			OUT = "Done. Checkbox untouch"	
	else:
		OUT = []
else:
	OUT = []
# ----------------------------------------
n4_выделить_сборку = Python(IN[0]=N_Programms)  # "4 Выделить сборку"
# ---------- n4_выделить_сборку.python (94 lines) ----------
import clr
import sys
import System
from System import Array
from System.Collections.Generic import *
clr.AddReference('ProtoGeometry')
from Autodesk.DesignScript.Geometry import *
DynPoint = Point
DynLine = Line
DynCurve = Curve
clr.AddReference("RevitNodes")
import Revit
clr.ImportExtensions(Revit.Elements)
clr.ImportExtensions(Revit.GeometryConversion)
clr.AddReference("RevitServices")
import RevitServices
from RevitServices.Persistence import DocumentManager 
from RevitServices.Transactions import TransactionManager 

clr.AddReference("RevitAPI")
clr.AddReference("RevitAPIUI")

import Autodesk 
from Autodesk.Revit.DB import *
from Autodesk.Revit.UI import *

from Autodesk.Revit.UI.Selection import *

def modifyFamSet(elementId, famDictionary):	
	famNameString = doc.GetElement(elementId).Symbol.FamilyName
	#Пробуем найти в нашем словаре сборку элементов
	setExist = False
	for famName in famDictionary.keys():
		if famName == famNameString:
			setExist = True 
	#Если не нашли, то делаем новую и возвращаем ее
	if not setExist:
		FilteredElements = FilteredElementCollector(doc)
		FilteredElements.OfClass(FamilyInstance)
		FilteredElements.WhereElementIsNotElementType()
		FilteredElements.ToElements()	
		set = []	
		for element in FilteredElements:	
			if element.Symbol.FamilyName == famNameString:
				set.append(element)	
		famDictionary[famNameString] = set
	return famDictionary[famNameString]
					
def SelectSetsByElement():
	elementIds = uidoc.Selection.GetElementIds()
	if not elementIds:
		return []
	famDictionary = {}
	currentSetIds = []
	for elementId in elementIds:
		element = doc.GetElement(elementId)
		currentSetIds.append(elementId)
		SetByName = modifyFamSet(elementId, famDictionary)
		p1 = element.LookupParameter("N_Набора").AsInteger()
		for elementByName in SetByName:	
			p2 = elementByName.LookupParameter("N_Набора").AsInteger()
			if p1 == p2:
				currentSetIds.append(elementByName.Id)
	return currentSetIds							




doc = DocumentManager.Instance.CurrentDBDocument
uiapp = DocumentManager.Instance.CurrentUIApplication 
app = uiapp.Application 
uidoc = uiapp.ActiveUIDocument

nProgramm = IN[0]
feetToMm = 0.00328084



if (nProgramm == 4):
	set = SelectSetsByElement()
	#MainSectionsSet_Filter = GetElements(FamilyNameForGet)
	#MainSectionsSet_Filter.insert(0,FamilyNameForGet)
	#MainSectionsSet_Filter.insert(0,"programm 4")	
	if set:
		ids = List[ElementId](1)
		for id in set:	
			ids.Add(id)
		uidoc.Selection.SetElementIds(ids)
		TaskDialog.Show("Оповещение!", 'Сборка выделена!')
		OUT = set
	else:
		OUT = []
else:
	OUT = []
# ----------------------------------------
