# Dynamo graph Размещение семейств на поверхности_v2.dyn "расстановка столбов по линииям_v2" (Dynamo 2.5.0.7460)

линии = DSModelElementsSelection()  # nothing selected
curves = Element.Curves(element=линии)
топография = DSModelElementSelection()  # 1 picked in the model; graph input
mesh = Topography.Mesh(topography=топография)
vertexPositions = Mesh.VertexPositions(mesh=mesh)
faceIndices = Mesh.FaceIndices(mesh=mesh)
A = IndexGroup.A(indexGroup=faceIndices)
getItemAtIndex = List.GetItemAtIndex(list=vertexPositions, index=A)
B = IndexGroup.B(indexGroup=faceIndices)
getItemAtIndex_2 = List.GetItemAtIndex(list=vertexPositions, index=B)
C = IndexGroup.C(indexGroup=faceIndices)
getItemAtIndex_3 = List.GetItemAtIndex(list=vertexPositions, index=C)
code_block = CodeBlock(a=getItemAtIndex, b=getItemAtIndex_2, c=getItemAtIndex_3) { List.Transpose([a,b,c]); }
byPerimeterPoints = Surface.ByPerimeterPoints(points=code_block)
byJoinedSurfaces = PolySurface.ByJoinedSurfaces(surfaces=byPerimeterPoints)
ZAxis = Vector.ZAxis()
project = Curve.Project(curve=curves, baseGeometry=byJoinedSurfaces, projectionDirection=ZAxis)
flatten = List.Flatten(list=project)
byJoinedCurves = PolyCurve.ByJoinedCurves(curves=flatten)
code_block_2 = CodeBlock { 90; }
pointsAtEqualSegmentLength = Curve.PointsAtEqualSegmentLength(curve=byJoinedCurves, divisions=code_block_2)
byPoints = NurbsCurve.ByPoints(points=pointsAtEqualSegmentLength)

# group: расстояние
code_block_3 = CodeBlock { 900; }

pointsAtSegmentLengthFromPoint = Curve.PointsAtSegmentLengthFromPoint(curve=byPoints, segmentLength=code_block_3)
flatten_2 = List.Flatten(list=pointsAtSegmentLengthFromPoint)
ZAxis_2 = Vector.ZAxis()
byPoints_2 = PolyCurve.ByPoints(points=flatten_2)
parameterAtPoint = Curve.ParameterAtPoint(curve=byPoints_2, point=flatten_2)
tangentAtParameter = Curve.TangentAtParameter(curve=byPoints_2, param=parameterAtPoint)
byOriginNormalXAxis = Plane.ByOriginNormalXAxis(origin=flatten_2, normal=ZAxis_2, xAxis=tangentAtParameter)
byPlane = CoordinateSystem.ByPlane(plane=byOriginNormalXAxis)
byCartesianCoordinates = Point.ByCartesianCoordinates(cs=byPlane)
YAxis = Vector.YAxis()
angleAboutAxis = Vector.AngleAboutAxis(vector=tangentAtParameter, otherVector=YAxis, rotationAxis=ZAxis_2)

# group: Экспорт CSV // для Civil
exportDialog = Python()  # frozen; unwired: IN[0]
# ---------- exportDialog.python (39 lines) ----------
import clr
clr.AddReference('System.Windows.Forms')
from System.Windows.Forms import *
clr.AddReference('RevitAPI')
import Autodesk
from Autodesk.Revit.DB import *

clr.AddReference('RevitAPIUI')
import Autodesk
from Autodesk.Revit.UI import *

clr.AddReference("RevitServices")
import RevitServices
from RevitServices.Persistence import DocumentManager
from RevitServices.Transactions import TransactionManager

doc = DocumentManager.Instance.CurrentDBDocument
uidoc=DocumentManager.Instance.CurrentUIApplication.ActiveUIDocument
uiapp=DocumentManager.Instance.CurrentUIApplication
app = uiapp.Application

window = SaveFileDialog()
window.Title = "Сохранить файл точек топоповерхности"
window.Filter = "CSV files (*.csv)|*.csv|TXT files (*.txt)|*.txt"
if window.ShowDialog() == DialogResult.OK:
	options = ImageExportOptions()
#	options.ExportRange = ExportRange.VisibleRegionOfCurrentView
	OUT = window.FileName
#	options.HLRandWFViewsFileType = ImageFileType.PNG # тип можно выбрать любой
#	if IN[0] == 150:
#		options.ImageResolution = ImageResolution.DPI_150 
#	if IN[0] == 300:
#		options.ImageResolution = ImageResolution.DPI_300 
#	if IN[0] == 300:
#		options.ImageResolution = ImageResolution.DPI_600 
#	options.ZoomType = ZoomFitType.Zoom
#	options.ShadowViewsFileType = ImageFileType.PNG
#	doc.ExportImage(options)
#
# ----------------------------------------
code_block_4 = CodeBlock(точки=byCartesianCoordinates) { точки; }
X = Point.X(point=code_block_4)
string_from_object = FromObject(obj=X)
code_block_5 = CodeBlock { "_"; }
Y = Point.Y(point=code_block_4)
string_from_object_2 = FromObject(obj=Y)
Z = Point.Z(point=code_block_4)
string_from_object_3 = FromObject(obj=Z)
code_block_6 = CodeBlock(углы=angleAboutAxis) { углы; }
string_from_object_4 = FromObject(obj=code_block_6)
code_block_7 = CodeBlock(a=string_from_object, x=code_block_5, b=string_from_object_2, c=string_from_object_3, d=string_from_object_4) { a+x+b+x+c+x+d; }
code_block_8 = CodeBlock { ","; }
code_block_9 = CodeBlock { "."; }
replace = String.Replace(str=code_block_7, searchFor=code_block_8, replaceWith=code_block_9)
replace_2 = String.Replace(str=replace, searchFor=code_block_5, replaceWith=code_block_8)
exportCSV = Data.ExportCSV(filePath=exportDialog, data=replace_2)

family_types = FamilyTypes("столбик для ограждения (1):столбик для ограждения (1)")
byPoint = FamilyInstance.ByPoint(familyType=family_types, point=byCartesianCoordinates)

# group: Финиш
setRotation = FamilyInstance.SetRotation(familyInstance=byPoint, degree=angleAboutAxis)

# group: GetRevitSelection
boolean = BoolSelector(true)
выборка_линий = Python(IN[0]=boolean)
# ---------- выборка_линий.python (21 lines) ----------
#Copyright(c) 2016, Dimitar Venkov
# @5devene, dimitar.ven@gmail.com

import clr

clr.AddReference("RevitNodes")
import Revit
clr.ImportExtensions(Revit.Elements)

clr.AddReference("RevitServices")
import RevitServices
from RevitServices.Persistence import DocumentManager
doc = DocumentManager.Instance.CurrentDBDocument
uidoc = DocumentManager.Instance.CurrentUIApplication.ActiveUIDocument

def output1(l1):
	if len(l1) == 1: return l1[0]
	else: return l1

selid = uidoc.Selection.GetElementIds()
OUT = output1([doc.GetElement(id).ToDSType(True) for id in selid])
# ----------------------------------------
